# Grasshopper definition windrose_plot.gh (Grasshopper 1.0.7)

panel = Panel("https://www.energyplus.net/weather-download/asia_wmo_region_2/CHN//CHN_Beijing.Beijing.545110_SWERA/all")
downloadepw = LBDownloadWeather(weather_URL=panel)  # -> epw_file, stat_file, ddy_file; plug-in component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
importepw = LBImportEPW(epw_file=downloadepw.epw_file)  # -> location, dry_bulb_temperature, dew_point_temperature, relative_humidity, wind_speed, wind_direction, direct_normal_rad, diffuse_horizontal_rad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; plug-in component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
windrose = LBWindRosePlot(
    data=[importepw.wind_speed, importepw.dry_bulb_temperature],
    wind_direction=importepw.wind_direction,
    dir_count=Slider(16, range=0..20),
    show_calmrose=Toggle(False),
    show_freq=Toggle(True))  # -> report, mesh, compass, orient_lines, freq_lines, legend, title; plug-in component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
panel_2 = Panel(windrose.report)
exportuo = LBExportUserObject(
    components=windrose.mesh,
    folder="C:\Users\Saeran\master\git\ladybug-grasshopper",
    change_type="fix",
    export=Toggle(False))  # -> report; plug-in component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
